# Grasshopper definition week1.gh (Grasshopper 1.0.7)
# plug-ins: Weaverbird

# ---- group: 单轨扫掠成圆环
circle = Circle(Plane=PlaneXY(0, 0, 0), Radius=Slider(20, range=1..20))
curve = Curve(reparameterize(circle))
domain = Domain(curve)
perp_frame = PerpFrame(Curve=curve, Parameter=Slider(0, range=0..1))
panel = Panel(domain)
circle_2 = Circle(Plane=perp_frame, Radius=Slider(6.4, range=1..10))
sweep1 = Sweep1(Rail=curve, Sections=circle_2, Miter=1)

# ---- group: 切割一部分
surface = Surface(reparameterize(sweep1))
construct_domain² = ConstructDomain²(UMin=Slider(0, range=0..1), UMax=Slider(0.5, range=0..1), VMin=Slider(1, range=0..1), VMax=Slider(0.5, range=0..1))
isotrim = Isotrim(Surface=surface, Domain=construct_domain²)

# ----
domain² = Domain²(surface)

# ---- group: 切割一部分 (continued)
panel_2 = Panel(domain²)

# ---- group: 切割成各个小面
divide_domain² = DivideDomain²(Domain=isotrim, UCount=Slider(17, range=1..20), VCount=Slider(7, range=1..20))
isotrim_2 = Isotrim(Surface=isotrim, Domain=divide_domain²)

# ---- group: 显示每个小面
list_item = ListItem(List=divide_domain², Index=Slider(8, range=0..100), Wrap=True)
isotrim_3 = Isotrim(Surface=isotrim, Domain=list_item)

# ---- group: 从 NURBS 到 MESH
simple_mesh = SimpleMesh(Brep=isotrim_2)

# ---- group: 成框、曲面化、挤出
number_slider = Slider(1, range=1..20)
weaverbird_s_picture_frame = WeaverbirdsPictureFrame(MeshPolylines=simple_mesh, Distance=number_slider, InsetType=0)  # -> flatten(OutMesh)
weaverbird_s_mesh_window = WeaverbirdsMeshWindow(MeshPolylines=simple_mesh, Distance=number_slider, InsetType=0)  # -> flatten(OutMesh)
number_slider_2 = Slider(3, range=0..10)
weaverbird_s_join_meshes_and_weld = WeaverbirdsJoinMeshesAndWeld(Mesh=weaverbird_s_picture_frame, Weld=False)
weaverbird_s_join_meshes_and_weld_2 = WeaverbirdsJoinMeshesAndWeld(Mesh=weaverbird_s_mesh_window, Weld=False)
weaverbird_s_catmull_clark_subdivision = WeaverbirdsCatmullClarkSubdivision(MeshCurves=weaverbird_s_join_meshes_and_weld, Level=number_slider_2, SmoothNakedEdges=1)
weaverbird_s_catmull_clark_subdivision_2 = WeaverbirdsCatmullClarkSubdivision(MeshCurves=weaverbird_s_join_meshes_and_weld_2, Level=number_slider_2, SmoothNakedEdges=1)
number_slider_3 = Slider(1, range=1..10)
weaverbird_s_mesh_thicken = WeaverbirdsMeshThicken(MeshCurves=weaverbird_s_catmull_clark_subdivision, Distance=number_slider_3, OffsetType=0)
weaverbird_s_mesh_thicken_2 = WeaverbirdsMeshThicken(MeshCurves=weaverbird_s_catmull_clark_subdivision_2, Distance=number_slider_3, OffsetType=0)

# ---- group: 测量
box = Box(weaverbird_s_mesh_thicken)
deconstruct_brep = DeconstructBrep(Brep=box)  # -> Faces, Edges, Vertices
list_item_2 = ListItem(List=deconstruct_brep.Edges, Index=Slider(4, range=0..11), Wrap=True)
line = Line(list_item_2)
line_dimension = LineDimension(Line=line, Text="{0:0.00}", Size=1)
