# Grasshopper definition week2.gh (Grasshopper 1.0.7)

# ---- group: 将平面分割并找到中心点
surface = Surface(reparameterize(<surface referenced from the Rhino model>))
number_slider = Slider(30, range=1..100)
divide_domain² = DivideDomain²(Domain=surface, UCount=number_slider, VCount=Slider(20, range=1..100))
number_slider_2 = Slider(0.5, range=0..1)
construct_point = ConstructPoint(XCoordinate=number_slider_2, YCoordinate=number_slider_2, ZCoordinate=0)
isotrim = Isotrim(Surface=surface, Domain=divide_domain²)
evaluate_surface = EvaluateSurface(Surface=reparameterize(isotrim), Point=construct_point)  # -> Point, Normal, UDirection, VDirection, Frame
point = Point(evaluate_surface.Point)
mesh = Mesh(<mesh referenced from the Rhino model>)

# ---- group: 将中心点投影到 Mesh 上
mesh_closest_point = MeshClosestPoint(Point=point, Mesh=mesh)  # -> Point, Index, Parameter

# ---- group: 利用点制作贴合的曲面
surface_from_points = SurfaceFromPoints(Points=mesh_closest_point.Point, UCount=number_slider, Interpolate=False)

# ---- group: 点的总数
list_length = ListLength(List=mesh_closest_point.Point)
panel = Panel(list_length)

# ---- group: 利用随机数选择点
construct_domain = ConstructDomain(DomainStart=Slider(0, range=0..100), DomainEnd=list_length)
random = Random(Range=construct_domain, Number=Slider(3, range=0..10), Seed=2, Integers=True)
panel_2 = Panel(random)

# ---- group: 利用与选择点的远近关系确定结构突出的高度
list_item = ListItem(List=mesh_closest_point.Point, Index=random, Wrap=True)
panel_3 = Panel(list_item)
closest_point = ClosestPoint(Point=mesh_closest_point.Point, Cloud=list_item)  # -> ClosestPoint, CPIndex, Distance
construct_domain_2 = ConstructDomain(DomainStart=Slider(0.01, range=0.01..1), DomainEnd=Slider(1.2, range=0.01..5))
bounds = Bounds(Numbers=closest_point.Distance)
panel_4 = Panel(closest_point.Distance)
remap_numbers = RemapNumbers(Value=closest_point.Distance, Source=bounds, Target=construct_domain_2)  # -> Mapped, Clipped
panel_5 = Panel(remap_numbers.Mapped)
multiplication = Multiplication(A=remap_numbers.Mapped, B=Slider(5, range=0..10))
unit_z = UnitZ(Factor=multiplication)
move = Move(Geometry=mesh_closest_point.Point, Motion=unit_z)  # -> Geometry, Transform

# ---- group: 将突出的点制成曲面并取中间的一部分
surface_from_points_2 = SurfaceFromPoints(Points=move.Geometry, UCount=number_slider, Interpolate=False)
surface_2 = Surface(surface_from_points_2)
divide_domain²_2 = DivideDomain²(Domain=surface_2, UCount=Slider(20, range=1..30), VCount=Slider(6, range=1..30))
number_slider_3 = Slider(0.15, range=0..1)
number_slider_4 = Slider(0.85, range=0..1)
isotrim_2 = Isotrim(Surface=surface_2, Domain=divide_domain²_2)  # -> reparameterize(Surface)
construct_domain² = ConstructDomain²(UMin=number_slider_3, UMax=number_slider_4, VMin=number_slider_3, VMax=number_slider_4)

# ---- group: 连接突出结构与 Mesh 曲面
isotrim_3 = Isotrim(Surface=isotrim_2, Domain=construct_domain²)
brep_edges = BrepEdges(Brep=isotrim_3)  # -> Naked, Interior, NonManifold
unit_z_2 = UnitZ(Factor=Slider(0.25, range=0.01..1))
unit_z_3 = UnitZ(Factor=1)
curve = Curve(brep_edges.Naked)
move_2 = Move(Geometry=isotrim_3, Motion=unit_z_2)  # -> graft(Geometry), Transform
projecttomesh = CSharpScript(Curve=curve, Mesh=mesh, Direction=unit_z_3)  # -> out, A; inputs Curve: Curve, Mesh: Mesh, Direction: Vector3d
# ---------- projecttomesh: C# ----------
    if (null != Curve && null != Mesh && Direction.IsValid)
    {
      var tol = RhinoDoc.ActiveDoc.ModelAbsoluteTolerance;
      A = Curve.ProjectToMesh(Curve, Mesh, Direction, tol);
    }
# ---------- end projecttomesh ----------
area = Area(Geometry=move_2.Geometry)  # -> Area, Centroid
deconstruct_brep = DeconstructBrep(Brep=move_2.Geometry)  # -> Faces, Edges, Vertices
mesh_closest_point_2 = MeshClosestPoint(Point=area.Centroid, Mesh=mesh)  # -> Point, Index, Parameter
line = Line(StartPoint=area.Centroid, EndPoint=mesh_closest_point_2.Point)
point_on_curve = PointOnCurve(line, parameter=0.5)
line_2 = Line(StartPoint=deconstruct_brep.Vertices, EndPoint=point_on_curve)

# ---- group: 将结构制作成有厚度和体积的实体
unit_z_4 = UnitZ(Factor=Slider(0.03, range=0.01..1))
extrude = Extrude(Base=move_2.Geometry, Direction=unit_z_4)  # disabled
pipe = Pipe(Curve=[line_2, line], Radius=Slider(0.02, range=0.01..1), Caps=0)  # disabled
