# Grasshopper definition week3_1_raw.gh (Grasshopper 1.0.7)
# plug-ins: Bifocals, Kangaroo2 Components

number_slider = Slider(151, range=1..200)  # disabled
number_slider_2 = Slider(30, range=0..100)  # disabled
number_slider_3 = Slider(380, range=0..900)  # disabled
surface = Surface(<surface referenced from the Rhino model>)  # disabled
brep = Brep(<brep referenced from the Rhino model>)  # disabled
brep_2 = Brep([<brep referenced from the Rhino model> x3])
unit_z = UnitZ(Factor=1)  # disabled
unit_z_2 = UnitZ(Factor=1)  # disabled
number_slider_4 = Slider(1, range=0.1..3)  # disabled
populate_3d = Populate3D(Region=brep, Count=number_slider, Seed=1)  # disabled
number_slider_5 = Slider(20, range=0..100)  # disabled
number_slider_6 = Slider(2, range=0..10000)  # disabled
deconstruct_brep = DeconstructBrep(Brep=surface)  # -> Faces, Edges, Vertices; disabled
negative = Negative(Value=unit_z)  # disabled
mesh_surface = MeshSurface(Surface=surface, UCount=number_slider_2, VCount=number_slider_2, Overhang=True, Equalize=False)  # disabled
deconstruct_mesh = DeconstructMesh(Mesh=mesh_surface)  # -> Vertices, Faces, Colours, Normals; disabled
list_item = ListItem(List=deconstruct_mesh.Vertices, Index=number_slider_3, Wrap=True)  # disabled
negative_2 = Negative(Value=unit_z_2)  # disabled
point = Point(populate_3d)  # disabled
rigidbody = RigidBody(Part=brep_2, Strength=10)  # -> RigidBody, Planes
solidcollide = SolidCollide(MeshA=brep_2, Strength=1)
point_2 = Point(list_item)  # disabled
number_slider_7 = Slider(10, range=10..30)  # disabled
number_slider_8 = Slider(0.1, range=0.1..10)  # disabled
point_on_curve = PointOnCurve(deconstruct_brep.Edges, parameter=0.5)  # disabled
load = Load(Point=point, ForceVector=negative_2, Weighting=1)  # disabled
floor = Floor(Strength=number_slider_6)  # disabled
spherecollide = SphereCollide(Points=point, Radius=number_slider_4, Strength=1)  # disabled
load_2 = Load(Point=point_2, ForceVector=negative, Weighting=number_slider_5)  # disabled
edgelengths = EdgeLengths(Mesh=mesh_surface, LengthFactor=1, Strength=number_slider_7)  # disabled
number_slider_9 = Slider(3, range=0..10)  # disabled
vertexloads = VertexLoads(Mesh=mesh_surface, Strength=number_slider_8)  # disabled
anchor = Anchor(Point=[deconstruct_brep.Vertices, point_on_curve], Strength=10000)  # disabled
boolean_toggle = BooleanToggle(True)  # disabled
button = Button()  # disabled
boolean_toggle_2 = BooleanToggle(True)  # disabled
entwine = Entwine(Branch00=anchor, Branch01=edgelengths, Branch02=vertexloads, Branch03=load_2, FlattenInputs=True)  # disabled
button_2 = Button()  # disabled
bouncysolver = BouncySolver(
    GoalObjects=flatten([spherecollide, load, floor]),
    Reset=button,
    Threshold=1e-15,
    Tolerance=0.01,
    Damping=0.99,
    Iterations=number_slider_9,
    On=boolean_toggle)  # -> I, V, O; disabled
bouncysolver_2 = BouncySolver(GoalObjects=entwine, Reset=button_2, Threshold=1e-15, Tolerance=0.01, Damping=0.99, Iterations=10, On=boolean_toggle_2)  # -> I, V, O; disabled
point_3 = Point(bouncysolver.V)  # disabled
mesh_sphere = MeshSphere(Base=point_3, Radius=number_slider_4, UCount=10, VCount=20)  # disabled
panel = Panel(point_3)  # disabled
