# Grasshopper definition week4.gh (Grasshopper 1.0.7)
# plug-ins: Bifocals

# ---- group: 原始曲面
curve = Curve([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])
loft = Loft(Curves=curve, Options={Adjust=False, Closed=False, LoftEnds=0, LoftSimp=0, LoftType=0, Rebuild=10, Refit=0.01})

# ---- group: 分割成小部分
divide_domain² = DivideDomain²(Domain=loft, UCount=Slider(15, range=0..100), VCount=Slider(17, range=0..100))

# ---- group: 分割成三角面
isotrim = Isotrim(Surface=loft, Domain=divide_domain²)
deconstruct_brep = DeconstructBrep(Brep=isotrim)  # -> Faces, Edges, Vertices
list_item = ListItem(List=deconstruct_brep.Vertices, Index=0, Wrap=True)
list_item_2 = ListItem(List=deconstruct_brep.Vertices, Index=1, Wrap=True)
list_item_3 = ListItem(List=deconstruct_brep.Vertices, Index=2, Wrap=True)
list_item_4 = ListItem(List=deconstruct_brep.Vertices, Index=3, Wrap=True)
_4point_surface = _4PointSurface(CornerA=list_item_2, CornerB=list_item_3, CornerC=list_item_4)
_4point_surface_2 = _4PointSurface(CornerA=list_item, CornerB=list_item_2, CornerC=list_item_4)

# ----
unit_y = UnitY(Factor=Slider(100, range=0..100))
move = Move(Geometry=loft, Motion=unit_y)  # -> Geometry, Transform

# ---- group: 建立等效平面
dimensions = Dimensions(Surface=move.Geometry)  # -> UDimension, VDimension
plane_surface = PlaneSurface(Plane=PlaneXY(0, 0, 0), XSize=dimensions.UDimension, YSize=dimensions.VDimension)

# ---- group: 所有三角面
surface = Surface(flatten([_4point_surface_2, _4point_surface]))

# ----
number_slider = Slider(200, range=0..1000)
deconstruct_brep_2 = DeconstructBrep(Brep=surface)  # -> Faces, Edges, Vertices

# ---- group: 取中心点
area = Area(Geometry=surface)  # -> Area, Centroid

# ---- group: 平面边线
curve_2 = Curve(plane_surface)

# ----
populate_2d = Populate2D(Region=plane_surface, Count=number_slider, Seed=number_slider)
point = Point(graft(area.Centroid))

# ---- group: 为每一个三角面建立平面
list_item_5 = ListItem(List=deconstruct_brep_2.Vertices, Index=0, Wrap=True)
list_item_6 = ListItem(List=deconstruct_brep_2.Vertices, Index=1, Wrap=True)
list_item_7 = ListItem(List=deconstruct_brep_2.Vertices, Index=2, Wrap=True)
plane_3pt = Plane3Pt(PointA=list_item_5, PointB=list_item_6, PointC=list_item_7)

# ---- group: 在面上等比例位置取点
md_slider = MDSlider(
    SliderMode=0,
    slider_value=Point(0.1844221441, 0.4675810279, 0.5),
    x_domain=Domain(0, 1),
    y_domain=Domain(0, 1),
    z_domain=Domain(0, 1))
md_slider_2 = MDSlider(
    SliderMode=0,
    slider_value=Point(0.689228337, 0.7241568216, 0.5),
    x_domain=Domain(0, 1),
    y_domain=Domain(0, 1),
    z_domain=Domain(0, 1))
evaluate_surface = EvaluateSurface(Surface=reparameterize(loft), Point=[md_slider, md_slider_2])  # -> Point, Normal, UDirection, VDirection, Frame
point_2 = Point(evaluate_surface.Point)

# ----
voronoi = Voronoi(Points=populate_2d, Boundary=curve_2, BruteForceOverride=False)

# ---- group: 建立 NURBS 曲线
explode = Explode(Curve=voronoi, Recursive=True)  # -> Segments, Vertices
cull_index = CullIndex(List=explode.Vertices, Indices=Slider(-1, range=-1..0), Wrap=True)
nurbs_curve = NurbsCurve(Vertices=cull_index, Degree=Slider(3, range=0..10), Periodic=Toggle(True))  # -> Curve, Length, Domain

# ----
area_2 = Area(Geometry=voronoi)  # -> Area, Centroid
scale = Scale(Geometry=voronoi, Center=area_2.Centroid, Factor=Slider(0.85, range=0..1))  # -> Geometry, Transform

# ---- group: 到所取点的距离
closest_point = ClosestPoint(Point=area.Centroid, Cloud=point_2)  # -> ClosestPoint, CPIndex, Distance
bounds = Bounds(Numbers=closest_point.Distance)

# ---- group: 取中点
point_on_curve = PointOnCurve(deconstruct_brep_2.Edges, parameter=0.5)

# ---- group: 直接使用直线来建面
number_slider_2 = Slider(3, range=0..10)  # disabled
boundary_surfaces = BoundarySurfaces(Edges=flatten([scale.Geometry, curve_2]))  # disabled
unit_z = UnitZ(Factor=number_slider_2)  # disabled
extrude = Extrude(Base=boundary_surfaces, Direction=unit_z)  # disabled
number_slider_3 = Slider(1, range=0..1)  # disabled
box = Box(extrude)  # disabled
surface_morph = SurfaceMorph(
    Geometry=extrude,
    Reference=box,
    Surface=reparameterize(move.Geometry),
    UDomain=number_slider_3,
    VDomain=number_slider_3,
    WDomain=number_slider_3)  # disabled

# ----
curve_3 = Curve(flatten([nurbs_curve.Curve, curve_2]))
boundary_surfaces_2 = BoundarySurfaces(Edges=curve_3)
unit_z_2 = UnitZ(Factor=Slider(3, range=0..10))
extrude_2 = Extrude(Base=boundary_surfaces_2, Direction=unit_z_2)
number_slider_4 = Slider(1, range=0..1)
box_2 = Box(extrude_2)
surface_morph_2 = SurfaceMorph(
    Geometry=extrude_2,
    Reference=box_2,
    Surface=reparameterize(move.Geometry),
    UDomain=number_slider_4,
    VDomain=number_slider_4,
    WDomain=number_slider_4)  # disabled

construct_domain = ConstructDomain(DomainStart=Slider(0.2, range=0..1), DomainEnd=Slider(2, range=0..10))

# ---- group: 从每边中点到中心点的单位向量
vector_2pt = Vector2Pt(PointA=point_on_curve, PointB=point, Unitize=Toggle(True))  # -> Vector, Length

# ----
remap_numbers = RemapNumbers(Value=closest_point.Distance, Source=bounds, Target=construct_domain)  # -> graft(Mapped), Clipped
construct_domain_2 = ConstructDomain(DomainStart=Slider(0, range=0..100), DomainEnd=Slider(2, range=0..10))
vector = Vector(plane_3pt)

sporph = Sporph(
    Geometry=extrude_2,
    Base=reparameterize(boundary_surfaces_2),
    Parameter="{1,1,1}",
    Target=reparameterize(move.Geometry),
    Parameter_2="{1,1,1}",
    Rigid=False)

remap_numbers_2 = RemapNumbers(Value=closest_point.Distance, Source=bounds, Target=construct_domain_2)  # -> graft(Mapped), Clipped
vector_display = VectorDisplay(Anchor=point, Vector=vector)
multiplication = Multiplication(A=vector_2pt.Vector, B=remap_numbers.Mapped)
negative = Negative(Value=remap_numbers_2.Mapped)
multiplication_2 = Multiplication(A=vector, B=negative)

# ---- group: 收缩点
move_2 = Move(Geometry=point_on_curve, Motion=multiplication)  # -> Geometry, Transform

# ---- group: 顶点
move_3 = Move(Geometry=point, Motion=multiplication_2)  # -> Geometry, Transform

# ---- group: 角点
point_3 = Point(deconstruct_brep_2.Vertices)

# ----
list_item_8 = ListItem(List=move_2.Geometry, Index=0, Wrap=True)
list_item_9 = ListItem(List=move_2.Geometry, Index=1, Wrap=True)
list_item_10 = ListItem(List=move_2.Geometry, Index=2, Wrap=True)
list_item_11 = ListItem(List=point_3, Index=0, Wrap=True)
list_item_12 = ListItem(List=point_3, Index=1, Wrap=True)
list_item_13 = ListItem(List=point_3, Index=2, Wrap=True)

# ---- group: 建立面
_4point_surface_3 = _4PointSurface(CornerA=move_3.Geometry, CornerB=list_item_9, CornerC=list_item_13)
_4point_surface_4 = _4PointSurface(CornerA=move_3.Geometry, CornerB=list_item_8, CornerC=list_item_11)
_4point_surface_5 = _4PointSurface(CornerA=move_3.Geometry, CornerB=list_item_8, CornerC=list_item_12)
_4point_surface_6 = _4PointSurface(CornerA=move_3.Geometry, CornerB=list_item_9, CornerC=list_item_12)
_4point_surface_7 = _4PointSurface(CornerA=move_3.Geometry, CornerB=list_item_10, CornerC=list_item_11)
_4point_surface_8 = _4PointSurface(CornerA=move_3.Geometry, CornerB=list_item_10, CornerC=list_item_13)

# ----
brep = Brep(flatten([_4point_surface_3, _4point_surface_4, _4point_surface_5, _4point_surface_6, _4point_surface_7, _4point_surface_8]))
custom_preview = CustomPreview(Geometry=brep, Material=ColourSwatch(SwatchColor=RGB(34, 105, 171)))
