# Grasshopper definition week4_2_raw.gh (Grasshopper 1.0.7)

curve = Curve(reparameterize(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))
curve_2 = Curve(reparameterize(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))
curve_3 = Curve(reparameterize(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))
curve_4 = Curve(reparameterize(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))
curve_5 = Curve(reparameterize(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))
evaluate_curve = EvaluateCurve(Curve=curve_2, Parameter=Slider(0.2, range=0..1))  # -> Point, Tangent, Angle
evaluate_curve_2 = EvaluateCurve(Curve=curve_3, Parameter=Slider(0.66, range=0..1))  # -> Point, Tangent, Angle
evaluate_curve_3 = EvaluateCurve(Curve=curve_4, Parameter=Slider(0.1, range=0..1))  # -> Point, Tangent, Angle
evaluate_curve_4 = EvaluateCurve(Curve=curve_5, Parameter=Slider(0.1, range=0..1))  # -> Point, Tangent, Angle
evaluate_curve_5 = EvaluateCurve(Curve=curve, Parameter=Slider(0.55, range=0..1))  # -> Point, Tangent, Angle
nurbs_curve = NurbsCurve(
    Vertices=[evaluate_curve.Point, evaluate_curve_2.Point, evaluate_curve_3.Point, evaluate_curve_4.Point, evaluate_curve_5.Point],
    Degree=3,
    Periodic=Toggle(True))  # -> Curve, Length, Domain
area = Area(Geometry=nurbs_curve.Curve)  # -> Area, Centroid
point = Point(Point(7.806368332, -9.116282898, 0))
distance = Distance(PointA=point, PointB=area.Centroid)
panel = Panel(distance)
